# Dynamo graph Check Topology.dyn (Dynamo 3.6.0.9395)
# packages: Topologic 1.4.0, Data-Shapes 2025.3.120

file_path = Filename(".\topologic.JSON")
python_script = Python(IN[0]=file_path)  # CPython3
# ---------- python_script.python (126 lines) ----------
# Dynamo Python: Visualize topologic.JSON (graph export from pyRevit script)
# Compatible with IronPython2 and CPython3.
#
# IN[0] : path (string) to topologic.JSON
#
# OUT:
#   0 -> Status / Messages
#   1 -> DS Points (vertices) list
#   2 -> DS Lines (edges) list (Line.ByStartPointEndPoint)
#   3 -> End Point (DS Point or None)
#   4 -> Start Points (list of DS Points in same order as start_points array)
#   5 -> Start Point Element IDs (parallel list of element_id)
#   6 -> Meta dictionary (if present)
#   7 -> Vertex Count
#   8 -> Edge Count
#   9 -> Mapping (vertex index -> Point) (list)
#
# Notes:
# - Assumes coordinates are in Revit internal units (feet). No unit conversion performed.
# - Handles absence of meta gracefully.
# - If JSON contains duplicate vertices (rare), returns them as-is.
#
import json, os, sys, traceback

# Dynamo geometry imports (works in both engines)
try:
    import clr
    clr.AddReference('ProtoGeometry')
    from Autodesk.DesignScript.Geometry import Point as DSPoint
    from Autodesk.DesignScript.Geometry import Line
except Exception as e:
    OUT = ["ERROR: Could not import Dynamo geometry: {}".format(e)], [], [], None, [], [], {}, 0, 0, []
    raise

path = IN[0] if len(IN) > 0 else None
messages = []

def fail(msg):
    return [msg], [], [], None, [], [], {}, 0, 0, []

if not path or not isinstance(path, str) or path.strip()=="":
    OUT = fail("No file path provided for topologic.JSON.")
else:
    path = path.strip('"').strip()
    if not os.path.exists(path):
        OUT = fail("File not found: {}".format(path))
    else:
        try:
            with open(path, 'r') as f:
                data = json.load(f)
            vertices = data.get("vertices", [])
            edges = data.get("edges", [])
            start_points_raw = data.get("start_points", [])
            end_pt_raw = data.get("end_point", None)
            meta = data.get("meta", {})

            # Build DS Points
            ds_vertices = []
            for v in vertices:
                try:
                    ds_vertices.append(DSPoint.ByCoordinates(float(v[0]), float(v[1]), float(v[2])))
                except:
                    ds_vertices.append(None)
                    messages.append("Vertex conversion failed for: {}".format(v))

            # Build DS Lines (edges reference indices)
            ds_edges = []
            for e in edges:
                try:
                    a, b = int(e[0]), int(e[1])
                    if 0 <= a < len(ds_vertices) and 0 <= b < len(ds_vertices):
                        pa = ds_vertices[a]; pb = ds_vertices[b]
                        if pa and pb:
                            ds_edges.append(Line.ByStartPointEndPoint(pa, pb))
                        else:
                            messages.append("Null vertex in edge {} -> skipped".format(e))
                    else:
                        messages.append("Edge index out of range: {}".format(e))
                except Exception as ex:
                    messages.append("Edge parse error {} : {}".format(e, ex))

            # Start points
            sp_points = []
            sp_ids = []
            for sp in start_points_raw:
                try:
                    p = sp.get("point")
                    eid = sp.get("element_id")
                    if p and len(p) == 3:
                        sp_points.append(DSPoint.ByCoordinates(float(p[0]), float(p[1]), float(p[2])))
                    else:
                        sp_points.append(None)
                        messages.append("Invalid start point coords: {}".format(p))
                    sp_ids.append(eid)
                except Exception as ex:
                    messages.append("Start point conversion error: {}".format(ex))
                    sp_points.append(None)
                    sp_ids.append(None)

            # End point
            end_pt = None
            if end_pt_raw and len(end_pt_raw) == 3:
                try:
                    end_pt = DSPoint.ByCoordinates(float(end_pt_raw[0]), float(end_pt_raw[1]), float(end_pt_raw[2]))
                except Exception as ex:
                    messages.append("End point conversion error: {}".format(ex))

            messages.insert(0, "Loaded topologic.JSON successfully.")
            messages.append("Vertices: {} | Edges: {} | StartPoints: {}"
                            .format(len(vertices), len(edges), len(sp_points)))

            OUT = [
                messages,          # 0
                ds_vertices,       # 1
                ds_edges,          # 2
                end_pt,            # 3
                sp_points,         # 4
                sp_ids,            # 5
                meta,              # 6
                len(vertices),     # 7
                len(edges),        # 8
                ds_vertices        # 9 (simple mapping list)
            ]
        except Exception as e:
            tb = traceback.format_exc()
            OUT = fail("Failed parsing JSON: {}\n{}".format(e, tb))
# ----------------------------------------
code_block = CodeBlock { [0]; [1]; [2]; [3]; [4]; [5]; [6]; [7]; [8]; }
topology_equipment_id = List.GetItemAtIndex(list=python_script, index=code_block.out5)
topology_vertices = List.GetItemAtIndex(list=python_script, index=code_block.out1)
topology_edges = List.GetItemAtIndex(list=python_script, index=code_block.out2)
topology_end_point = List.GetItemAtIndex(list=python_script, index=code_block.out3)
topology_start_points = List.GetItemAtIndex(list=python_script, index=code_block.out4)
list_create = List.Create(item0=topology_vertices, item1=topology_edges, item2=topology_end_point, item3=topology_start_points)
byGeometry = Topologic.Topology.ByGeometry(geometry=list_create)
byTopologies = Topologic.Cluster.ByTopologies(topologies=byGeometry)
selfMerge = Topologic.Topology.SelfMerge(topology=byTopologies)
byTopology = Topologic.Graph.ByTopology(topology=selfMerge)
X = Point.X(point=topology_end_point)
Y = Point.Y(point=topology_end_point)
Z = Point.Z(point=topology_end_point)
verticesAtCoordinates = Topologic.Graph.VerticesAtCoordinates(graph=byTopology, x=X, y=Y, z=Z)
X_2 = Point.X(point=topology_start_points)
Y_2 = Point.Y(point=topology_start_points)
Z_2 = Point.Z(point=topology_start_points)
verticesAtCoordinates_2 = Topologic.Graph.VerticesAtCoordinates(graph=byTopology, x=X_2, y=Y_2, z=Z_2)
shortestPath = Topologic.Graph.ShortestPath(graph=byTopology, startVertex=verticesAtCoordinates, endVertex=verticesAtCoordinates_2)
geomPreview = GeomPreviewNodeModel(SliderValue=255, rValue="27", gValue="255", bValue="57")  # frozen; unwired: Geometry
